# Grasshopper definition Graph.TemperatureRange.ghx (Grasshopper 1.0.7)

path = FilePath("/Users/yukio/Documents/GitHub/GH-FuncBase/[Graph]/Temperature Range/参考文件测试.csv")
file = ReadFile(File=path, PerLineParse=True)
panel = Panel(file)
split = TextSplit(Text=file, Separators=",")  # -> simplify(Result)
lng = ListLength(List=split)  # -> flatten(Length)
bnd = Bounds(Numbers=lng)
dedomain = DeconstructDomain(Domain=bnd)  # -> Start, End
culln = CullNth(List=split, CullFrequency=dedomain.End)
flip = FlipMatrix(Data=culln)
panel_2 = Panel(flip)
number_slider = Slider(10, range=0..10)
xz = XZPlane(Origin=Point(0, 0, 0))
recgrid = Rectangular(Plane=xz, SizeX=number_slider, SizeY=2, ExtentX=expr("x-1", "12"), ExtentY="1")  # -> Cells, Points
item = ListItem(List=recgrid.Points, Index=0, Wrap=True)
pt = Point(item)
division = Division(A=number_slider, B="2")
X = UnitX(Factor=division)
move = Move(Geometry=pt, Motion=X)  # -> Geometry, Transform
